# Dynamo graph AddPrefixToTypeName.dyn "Rename IfcMaterial to PA1_IfcMaterial" (Dynamo 3.3.0.6316)

# group: Select Models
select_model_elements = DSModelElementsSelection()  # 5953 picked in the model; graph input
watch = Watch(select_model_elements)

string = StringInput("IfcMaterial")
getParameterValueByName = Element.GetParameterValueByName(element=select_model_elements, parameterName=string)
watch_2 = Watch(getParameterValueByName)
string_2 = StringInput("PA1")  # graph input
python_script = Python(IN[0]=string_2, IN[1]=getParameterValueByName)  # CPython3
# ---------- python_script.python (21 lines) ----------
# Load the Python Standard and DesignScript Libraries
import sys
import clr
clr.AddReference('ProtoGeometry')
from Autodesk.DesignScript.Geometry import *

# The inputs to this node will be stored as a list in the IN variables.
dataEnteringNode = IN

#Inputs: prefix(IN[0]), itemList(IN[1])
prefix = IN[0]
itemList = IN[1] if len(IN) > 1 else []

# Place your code below this line

result = []
for item in itemList:
    result.append(prefix + "_" + str(item))

# Assign your output to the OUT variable.
OUT = result
# ----------------------------------------

# group: Output
setParameterByName = Element.SetParameterByName(element=select_model_elements, parameterName=string, value=python_script)
watch_3 = Watch(setParameterByName)

watch_4 = Watch(python_script)
parameters = Element.Parameters(element=select_model_elements)
watch_5 = Watch(parameters)
if_ = RefactoredIf()  # unwired: test, true, false
isNull = Object.IsNull()  # unwired: object
