# Dynamo graph Autodesk_Excel Import.dyn "Excel Import" (Dynamo 3.5.2.8914)

file_path = Filename(".\Podium_2026_05_18_09-23-17.xlsx")
string = StringInput("Sheet1")
string_2 = StringInput("true")
openXMLImportExcel = Data.OpenXMLImportExcel(filePath=file_path, sheetName=string, readAsString=string_2)
code_block = CodeBlock { "WBS Code"; }
code_block_2 = CodeBlock { "ID"; }
code_block_3 = CodeBlock { "WBS Code"; }
code_block_4 = CodeBlock { "false"; }
code_block_5 = CodeBlock { "0"; }
code_block_6 = CodeBlock { "false"; }
code_block_7 = CodeBlock { "false"; }
python_script = Python(IN[0]=openXMLImportExcel, IN[1]=code_block, IN[2]=code_block_2, IN[3]=code_block_3, IN[4]=code_block_4, IN[5]=code_block_5, IN[6]=code_block_6, IN[7]=code_block_7)  # CPython3
# ---------- python_script.python (387 lines) ----------
# Dynamo Python node script for Revit 2026
# Purpose: read Excel rows containing a Revit Element ID column and a value column,
#          then write the value into a custom instance parameter on the matching Revit element.
#
# Recommended Dynamo inputs:
# IN[0] = Excel data as rows, from Data.OpenXML.ImportExcel / Excel.ReadFromFile, with a header row
# IN[1] = Target Revit parameter name to write, e.g. "WBS Code"
# IN[2] = Element ID header name, e.g. "ID"
# IN[3] = Excel value header name, e.g. "WBS Code"
# IN[4] = Dry run? True previews only, False writes to Revit. Recommended first run: True
# IN[5] = Sheet index if your Excel node returns all sheets. Default: 0
# IN[6] = Clear blank values? False skips blank WBS values. True writes blanks
# IN[7] = If instance parameter is missing, try type parameter? Default: False
#
# Output: [status text, summary dictionary, report table]

import clr
import re
import math

clr.AddReference('RevitAPI')
from Autodesk.Revit.DB import ElementId, StorageType

clr.AddReference('RevitServices')
from RevitServices.Persistence import DocumentManager
from RevitServices.Transactions import TransactionManager

from System import Int64


doc = DocumentManager.Instance.CurrentDBDocument


def get_input(index, default_value=None):
    try:
        if len(IN) > index and IN[index] is not None:
            return IN[index]
    except Exception:
        pass
    return default_value


def to_bool(value, default_value=False):
    if value is None:
        return default_value
    if isinstance(value, bool):
        return value
    s = str(value).strip().lower()
    if s in ("true", "t", "yes", "y", "1"):
        return True
    if s in ("false", "f", "no", "n", "0"):
        return False
    return default_value


def to_int(value, default_value=0):
    try:
        return int(float(str(value).strip()))
    except Exception:
        return default_value


def is_sequence(value):
    return isinstance(value, (list, tuple))


def choose_table(data, sheet_index):
    """Accepts either rows or sheets->rows and returns one table as rows."""
    if data is None:
        return []
    if not is_sequence(data):
        return []
    if len(data) == 0:
        return []

    # If this is sheets -> rows -> cells, data[0][0] is a row list.
    try:
        first_non_empty = None
        for item in data:
            if item is not None and (not is_sequence(item) or len(item) > 0):
                first_non_empty = item
                break
        if is_sequence(first_non_empty) and len(first_non_empty) > 0 and is_sequence(first_non_empty[0]):
            idx = max(0, min(sheet_index, len(data) - 1))
            return data[idx]
    except Exception:
        pass

    # Otherwise assume this is already rows -> cells.
    return data


def normalize_header(value):
    if value is None:
        return ""
    s = str(value).strip().lower()
    s = s.replace("\n", " ").replace("\r", " ").replace("_", " ").replace("-", " ")
    while "  " in s:
        s = s.replace("  ", " ")
    return s


def make_header_map(row):
    mapping = {}
    for index, value in enumerate(row):
        key = normalize_header(value)
        if key and key not in mapping:
            mapping[key] = index
    return mapping


def find_column(header_map, names):
    for name in names:
        key = normalize_header(name)
        if key in header_map:
            return header_map[key]
    return None


def get_cell(row, index):
    if not is_sequence(row):
        return None
    if index is None or index < 0 or index >= len(row):
        return None
    return row[index]


def cell_to_text(value):
    if value is None:
        return ""
    if isinstance(value, float):
        if math.isfinite(value) and abs(value - round(value)) < 0.0000001:
            return str(int(round(value)))
        return str(value).strip()
    return str(value).strip()


def parse_element_id(value):
    if value is None or isinstance(value, bool):
        return None

    # Already a Revit ElementId.
    try:
        if isinstance(value, ElementId):
            return int(value.Value)
    except Exception:
        pass

    if isinstance(value, int):
        return int(value)

    if isinstance(value, float):
        if math.isfinite(value) and abs(value - round(value)) < 0.0000001:
            return int(round(value))
        return None

    s = str(value).strip()
    if not s:
        return None

    # Common Excel/string cleanup.
    s = s.replace(",", "")
    if s.startswith("'"):
        s = s[1:]

    # Accept "2473950", "2473950.0", or scientific notation produced by Excel.
    try:
        f = float(s)
        if math.isfinite(f) and abs(f - round(f)) < 0.0000001:
            return int(round(f))
    except Exception:
        pass

    # Last fallback for text such as "ElementId(2473950)".
    m = re.search(r"-?\d+", s)
    if m:
        try:
            return int(m.group(0))
        except Exception:
            return None

    return None


def element_name(element):
    try:
        return element.Name
    except Exception:
        try:
            return element.GetType().Name
        except Exception:
            return ""


def get_target_parameter(element, parameter_name, allow_type_parameter):
    parameter = element.LookupParameter(parameter_name)
    source = "Instance"

    if parameter is None and allow_type_parameter:
        try:
            type_id = element.GetTypeId()
            if type_id is not None and type_id != ElementId.InvalidElementId:
                element_type = doc.GetElement(type_id)
                if element_type is not None:
                    parameter = element_type.LookupParameter(parameter_name)
                    source = "Type"
        except Exception:
            parameter = None

    return parameter, source


def set_parameter_value(parameter, value):
    storage_type = parameter.StorageType

    if storage_type == StorageType.String:
        return parameter.Set(cell_to_text(value))

    if storage_type == StorageType.Integer:
        text = cell_to_text(value)
        number = 0 if text == "" else int(float(text))
        return parameter.Set(number)

    if storage_type == StorageType.Double:
        text = cell_to_text(value)
        number = 0.0 if text == "" else float(text)
        return parameter.Set(number)

    if storage_type == StorageType.ElementId:
        eid_value = parse_element_id(value)
        if eid_value is None:
            raise Exception("Value cannot be converted to ElementId")
        return parameter.Set(ElementId(Int64(eid_value)))

    raise Exception("Unsupported parameter storage type: {0}".format(storage_type))


excel_data = get_input(0, [])
target_parameter_name = cell_to_text(get_input(1, "WBS Code"))
id_header_name = cell_to_text(get_input(2, "ID"))
value_header_name = cell_to_text(get_input(3, "WBS Code"))
dry_run = to_bool(get_input(4, True), True)
sheet_index = to_int(get_input(5, 0), 0)
clear_blank_values = to_bool(get_input(6, False), False)
try_type_parameter_if_missing = to_bool(get_input(7, False), False)

rows = choose_table(excel_data, sheet_index)
report_header = ["Excel Row", "Element ID", "Element Name", "Parameter", "Value", "Status", "Message"]
report = []
summary = {
    "target_parameter": target_parameter_name,
    "id_header": id_header_name,
    "value_header": value_header_name,
    "dry_run": dry_run,
    "total_data_rows": 0,
    "preview_or_updated": 0,
    "already_or_blank_skipped": 0,
    "invalid_id": 0,
    "element_not_found": 0,
    "parameter_missing": 0,
    "read_only": 0,
    "failed": 0,
    "duplicates_seen": 0
}

if not target_parameter_name:
    OUT = ["ERROR: Target parameter name is blank.", summary, [report_header] + report]
elif not rows or not is_sequence(rows):
    OUT = ["ERROR: No Excel rows received. Check the Excel import node and Python IN[0].", summary, [report_header] + report]
else:
    # Find the header row. This lets the file contain a title row above the actual headers.
    header_row_index = None
    id_column_index = None
    value_column_index = None

    id_candidates = [id_header_name, "ID", "Element ID", "Revit Element ID", "Revit ID", "ElementId"]
    value_candidates = [value_header_name]

    search_limit = min(30, len(rows))
    for row_index in range(search_limit):
        row = rows[row_index]
        if not is_sequence(row):
            continue
        header_map = make_header_map(row)
        possible_id_column = find_column(header_map, id_candidates)
        possible_value_column = find_column(header_map, value_candidates)
        if possible_id_column is not None and possible_value_column is not None:
            header_row_index = row_index
            id_column_index = possible_id_column
            value_column_index = possible_value_column
            break

    if header_row_index is None:
        sample_headers = []
        try:
            sample_headers = [cell_to_text(x) for x in rows[0]]
        except Exception:
            sample_headers = []
        OUT = [
            "ERROR: Could not find headers '{0}' and '{1}' in the first 30 rows.".format(id_header_name, value_header_name),
            summary,
            [report_header] + [[1, "", "", target_parameter_name, "", "HeaderNotFound", ", ".join(sample_headers)]]
        ]
    else:
        seen_ids = set()
        transaction_started = False

        try:
            if not dry_run:
                TransactionManager.Instance.EnsureInTransaction(doc)
                transaction_started = True

            for excel_row_number, row in enumerate(rows[header_row_index + 1:], header_row_index + 2):
                if not is_sequence(row):
                    continue

                raw_id = get_cell(row, id_column_index)
                raw_value = get_cell(row, value_column_index)
                element_id_value = parse_element_id(raw_id)
                value_text = cell_to_text(raw_value)

                # Skip completely empty lines.
                if element_id_value is None and value_text == "":
                    continue

                summary["total_data_rows"] += 1

                if element_id_value is None or element_id_value <= 0:
                    summary["invalid_id"] += 1
                    report.append([excel_row_number, cell_to_text(raw_id), "", target_parameter_name, value_text, "InvalidId", "ID is blank, zero, negative, or not numeric"])
                    continue

                duplicate_note = ""
                if element_id_value in seen_ids:
                    summary["duplicates_seen"] += 1
                    duplicate_note = "Duplicate Element ID in Excel; this row was still processed. "
                seen_ids.add(element_id_value)

                if value_text == "" and not clear_blank_values:
                    summary["already_or_blank_skipped"] += 1
                    report.append([excel_row_number, element_id_value, "", target_parameter_name, value_text, "BlankSkipped", duplicate_note + "Blank value skipped; set Clear Blank Values to True to clear the parameter"])
                    continue

                try:
                    element = doc.GetElement(ElementId(Int64(element_id_value)))
                except Exception as ex_get:
                    element = None
                    summary["failed"] += 1
                    report.append([excel_row_number, element_id_value, "", target_parameter_name, value_text, "Failed", duplicate_note + "Could not create/get ElementId: {0}".format(ex_get)])
                    continue

                if element is None:
                    summary["element_not_found"] += 1
                    report.append([excel_row_number, element_id_value, "", target_parameter_name, value_text, "ElementNotFound", duplicate_note + "No element with this ID exists in the active Revit document"])
                    continue

                parameter, parameter_source = get_target_parameter(element, target_parameter_name, try_type_parameter_if_missing)

                if parameter is None:
                    summary["parameter_missing"] += 1
                    report.append([excel_row_number, element_id_value, element_name(element), target_parameter_name, value_text, "ParameterMissing", duplicate_note + "Parameter not found on the element instance"])
                    continue

                if parameter.IsReadOnly:
                    summary["read_only"] += 1
                    report.append([excel_row_number, element_id_value, element_name(element), target_parameter_name, value_text, "ReadOnly", duplicate_note + "Parameter exists but is read-only"])
                    continue

                if dry_run:
                    summary["preview_or_updated"] += 1
                    report.append([excel_row_number, element_id_value, element_name(element), target_parameter_name, value_text, "Preview", duplicate_note + "Would write to {0} parameter".format(parameter_source)])
                    continue

                try:
                    set_parameter_value(parameter, raw_value)
                    summary["preview_or_updated"] += 1
                    report.append([excel_row_number, element_id_value, element_name(element), target_parameter_name, value_text, "Updated", duplicate_note + "Written to {0} parameter".format(parameter_source)])
                except Exception as ex_set:
                    summary["failed"] += 1
                    report.append([excel_row_number, element_id_value, element_name(element), target_parameter_name, value_text, "Failed", duplicate_note + str(ex_set)])

        finally:
            if transaction_started:
                TransactionManager.Instance.TransactionTaskDone()

        status_text = "Dry run complete. No Revit changes were made." if dry_run else "Complete. Revit parameters were updated where possible."
        OUT = [status_text, summary, [report_header] + report]
# ----------------------------------------
watch = Watch(python_script)
watch_2 = Watch(openXMLImportExcel)
