# Dynamo graph Autodesk_export_sharedparameters.dyn "ExportParameters" (Dynamo 3.3.0.6316)

export_shared_parameter = Python()  # "Export Shared Parameter Definitions"; CPython3; unwired: IN[0]
# ---------- export_shared_parameter.python (68 lines) ----------
import clr
import sys
clr.AddReference('RevitAPI')
from Autodesk.Revit.DB import *
from Autodesk.Revit.DB.Structure import *

clr.AddReference('RevitAPIUI')
from Autodesk.Revit.UI import *

clr.AddReference('System')
import System
from System.Collections.Generic import List
from System import Guid as Guid
clr.AddReference('RevitNodes')
import Revit
clr.ImportExtensions(Revit.GeometryConversion)
clr.ImportExtensions(Revit.Elements)

clr.AddReference('RevitServices')
import RevitServices
from RevitServices.Persistence import DocumentManager
from RevitServices.Transactions import TransactionManager

doc = DocumentManager.Instance.CurrentDBDocument
uidoc=DocumentManager.Instance.CurrentUIApplication.ActiveUIDocument
uiapp = DocumentManager.Instance.CurrentUIApplication
app = uiapp.Application

#Preparing input from dynamo to revit
element = UnwrapElement(IN[0])

#Do some action in a Transaction
TransactionManager.Instance.EnsureInTransaction(doc)
parameters = FilteredElementCollector(doc).OfClass(SharedParameterElement).WhereElementIsNotElementType()

definition_file = app.OpenSharedParameterFile()
definition_groups = definition_file.Groups


try:
    definition_groups.Create("Exported Parameters")
except Exception as e:
    print(e)
    


def export_shared_parameters(definition_groups):
    exported_definitions = dict()
    for i in definition_groups:
        if i.Name != "Exported Parameters":
            continue
        names = [definition.Name for definition in i.Definitions]
        for parameter in parameters:
            if parameter.Name in names:
                continue
            definition = parameter.GetDefinition()
            try:
                options = ExternalDefinitionCreationOptions(parameter.Name, definition.GetDataType())
            except Exception as e:
                print(e)
            options.GUID = parameter.GuidValue
            try:
                exported_definition = i.Definitions.Create(options)
                exported_definitions[parameter.Name] = exported_definition
            except Exception as e:
                print(e)
    return {"Exported Definitions": exported_definitions}
OUT = export_shared_parameters(definition_groups)
# ----------------------------------------
