# Dynamo graph CentralGridLines.dyn (Dynamo 2.19.3.6394)
# packages: Crumple 2026.8.1

# group: Grid Selection
parameter_to_use = StringInput("Grid Location")  # graph input
string = StringInput("Grids")
byName = Category.ByName(name=string)
all_elements_of_category = ElementsOfCategory(Category=byName)
name = Element.Name(element=all_elements_of_category)
curve = Grid.Curve(grid=all_elements_of_category)
direction = Line.Direction(line=curve)
select_model_element = DSModelElementSelection()  # 1 picked in the model; graph input
curve_2 = Grid.Curve(grid=select_model_element)
direction_2 = Line.Direction(line=curve_2)
isParallel = Vector.IsParallel(vector=direction, otherVector=direction_2)
filterByBoolMask = List.FilterByBoolMask(list=name, mask=isParallel)
code_block = CodeBlock { "-"; }
add = filterByBoolMask.in + code_block  # lacing=CrossProduct
add_2 = add + filterByBoolMask.out  # lacing=CrossProduct
flatten = List.Flatten(list=add_2)
filterByBoolMask_2 = List.FilterByBoolMask(list=curve, mask=isParallel)
intersect = Geometry.Intersect(geometry=filterByBoolMask_2.in, other=filterByBoolMask_2.out, lacing=CrossProduct)
flatten_2 = List.Flatten(list=intersect)
code_block_2 = CodeBlock(pt=flatten_2) { pt.X; pt.Y; }
byCoordinates = Point.ByCoordinates(x=code_block_2.out0, y=code_block_2.out1)

# group: Elements Coordinates
all_elements_in_active_view = ElementsInView()
element_centroid = Custom[© Element.Centroid](element=all_elements_in_active_view, lacing=Shortest)  # package Crumple; Returns the centroid of the element's axis-aligned bounding box.
code_block_3 = CodeBlock(pt=element_centroid) { pt.X; pt.Y; pt.Z; }
byCoordinates_2 = Point.ByCoordinates(x=code_block_3.out0, y=code_block_3.out1)
distanceTo = Geometry.DistanceTo(geometry=byCoordinates_2@L1, other=byCoordinates@L2, lacing=Longest)
sortIndexByValue = List.SortIndexByValue(list=distanceTo@L2)
firstItem = List.FirstItem(list=sortIndexByValue@L2)

getItemAtIndex = List.GetItemAtIndex(list=flatten, index=firstItem)
setParameterByName = Element.SetParameterByName(element=all_elements_in_active_view, parameterName=parameter_to_use, value=getItemAtIndex)

# group: Level Location
parameter_to_use_2 = StringInput("GridLocationZZ")  # graph input
categories = Categories("OST_Levels")  # frozen
all_elements_of_category_2 = ElementsOfCategory(Category=categories)
elevation = Level.Elevation(level=all_elements_of_category_2)
sub = code_block_3.out2 - elevation
abs = Math.Abs(number=sub)
sortIndexByValue_2 = List.SortIndexByValue(list=abs@L2)
firstItem_2 = List.FirstItem(list=sortIndexByValue_2@L2)
setParameterByName_2 = Element.SetParameterByName(element=all_elements_in_active_view, parameterName=parameter_to_use_2, value=firstItem_2)
