# Dynamo graph GetAllRoomInteriorElevationViews_V4.dyn (Dynamo 2.19.3.6394)
# packages: Crumple 2026.8.1, Rhythm 2025.10.3

collect_rooms = Custom[© Collect.Rooms]()  # package Crumple; Collects all valid/invalid rooms as two lists. Invalid rooms are not placed, or have issues that make their area invalid (not enclosed, redundant etc.).
view_family_types = ViewFamilyTypes("Building Elevation")  # graph input
ViewScale = Input(ViewScale: int = 50)
python_script_1 = Python(IN[0]=collect_rooms.valid, IN[1]=view_family_types, IN[2]=ViewScale)  # CPython3; graph output
# ---------- python_script_1.python (467 lines) ----------
import clr

# ==================================================
# REFERENCES
# ==================================================

clr.AddReference("RevitAPI")
clr.AddReference("RevitServices")
clr.AddReference("System.Windows.Forms")

from Autodesk.Revit.DB import *
from RevitServices.Persistence import DocumentManager
from RevitServices.Transactions import TransactionManager
from System.Windows.Forms import MessageBox

doc = DocumentManager.Instance.CurrentDBDocument

# ==================================================
# INPUTS
# ==================================================

# IN[0] = Rooms
# IN[1] = Elevation View Family Type
# IN[2] = View Scale (optional)

rooms = UnwrapElement(IN[0]) if IN[0] else []
viewFamilyType = UnwrapElement(IN[1]) if IN[1] else None
viewScale = IN[2] if len(IN) > 2 and IN[2] else 50

# ==================================================
# HELPERS
# ==================================================

def get_room_title(room):

    room_num = ""
    room_name = ""

    try:
        p = room.LookupParameter("Number")
        if p and p.HasValue:
            room_num = p.AsString()
    except:
        pass

    try:
        p = room.LookupParameter("Name")
        if p and p.HasValue:
            room_name = p.AsString()
    except:
        pass

    if room_num and room_name:
        return "{} - {}".format(room_num, room_name)

    elif room_num:
        return room_num

    elif room_name:
        return room_name

    return "Unnamed Room"


def get_room_center(room):

    bbox = room.get_BoundingBox(None)

    if not bbox:
        return None

    try:
        z = room.Location.Point.Z
    except:
        z = (bbox.Min.Z + bbox.Max.Z) / 2.0

    return XYZ(
        (bbox.Min.X + bbox.Max.X) / 2.0,
        (bbox.Min.Y + bbox.Max.Y) / 2.0,
        z
    )


def get_room_dimensions(room):

    bbox = room.get_BoundingBox(None)

    if not bbox:
        return None

    width = abs(bbox.Max.X - bbox.Min.X)
    depth = abs(bbox.Max.Y - bbox.Min.Y)
    height = abs(bbox.Max.Z - bbox.Min.Z)

    if height < 8:
        height = 10.0

    return width, depth, height


def view_exists(view_name):

    views = FilteredElementCollector(doc)\
        .OfClass(View)

    for v in views:

        try:
            if v.Name.upper() == view_name.upper():
                return True
        except:
            pass

    return False
    
### Set Project Browsing View parameter as ROOMS    
def set_project_browsing_view(view):

    try:

        p = view.LookupParameter(
            "Project Browsing View"
        )

        if p and not p.IsReadOnly:

            p.Set("ROOMS")

    except:
        pass

# ==================================================
# VALIDATION
# ==================================================

if not rooms:

    OUT = "No rooms supplied."

elif not viewFamilyType:

    OUT = "No Elevation ViewFamilyType supplied."

elif not isinstance(doc.ActiveView, ViewPlan):

    OUT = "Run script from a Floor Plan view."

else:

    sourcePlan = doc.ActiveView

    if sourcePlan.IsTemplate:

        OUT = "Active View cannot be a View Template."

    else:

        activeLevelId = sourcePlan.GenLevel.Id

        results = []
        created_views = []

        success_count = 0
        fail_count = 0
        skipped_count = 0

        total_elevations = 0
        plan_count = 0

        suffixes = ["NORTH", "EAST", "SOUTH", "WEST"]

        TransactionManager.Instance.EnsureInTransaction(doc)

        for room in rooms:

            try:

                room_title = get_room_title(room)

                # =====================================
                # LEVEL FILTER
                # =====================================

                if room.LevelId != activeLevelId:

                    skipped_count += 1

                    results.append(
                        "SKIPPED : {} (Different Level)"
                        .format(room_title)
                    )

                    continue

                center = get_room_center(room)

                if not center:

                    fail_count += 1

                    results.append(
                        "FAILED : {} (No center point)"
                        .format(room_title)
                    )

                    continue

                dims = get_room_dimensions(room)

                if not dims:

                    fail_count += 1

                    results.append(
                        "FAILED : {} (No room dimensions)"
                        .format(room_title)
                    )

                    continue

                room_width, room_depth, room_height = dims

                # =====================================
                # CREATE ROOM PLAN
                # =====================================

                planName = room_title + " - PLAN"

                roomPlan = None

                if view_exists(planName):

                    results.append(
                        "PLAN EXISTS : {}".format(planName)
                    )

                else:

                    duplicatedId = sourcePlan.Duplicate(
                        ViewDuplicateOption.Duplicate
                    )

                    roomPlan = doc.GetElement(
                        duplicatedId
                    )

                    try:
                        roomPlan.Name = planName
                    except:
                        pass

                    try:
                        roomPlan.Scale = int(viewScale)
                    except:
                        pass

                    try:

                        bbox = room.get_BoundingBox(None)

                        offset = 2.0

                        crop = roomPlan.CropBox

                        crop.Min = XYZ(
                            bbox.Min.X - offset,
                            bbox.Min.Y - offset,
                            crop.Min.Z
                        )

                        crop.Max = XYZ(
                            bbox.Max.X + offset,
                            bbox.Max.Y + offset,
                            crop.Max.Z
                        )

                        roomPlan.CropBox = crop
                        roomPlan.CropBoxActive = True
                        roomPlan.CropBoxVisible = False

                    except:
                        pass

                    try:
                        comments = roomPlan.LookupParameter("Comments")
                        if comments:
                            comments.Set(
                                str(room.Id.IntegerValue)
                            )
                    except:
                        pass

                    created_views.append(roomPlan)
                    ###
                    set_project_browsing_view(roomPlan)
                    
                    plan_count += 1

                doc.Regenerate()

                # =====================================
                # CREATE ELEVATION MARKER
                # =====================================

                marker = ElevationMarker.CreateElevationMarker(
                    doc,
                    viewFamilyType.Id,
                    center,
                    5.0
                )

                doc.Regenerate()

                # =====================================
                # CREATE ELEVATIONS
                # =====================================

                for idx in range(4):

                    elevName = "{} - {}".format(
                        room_title,
                        suffixes[idx]
                    )

                    if view_exists(elevName):

                        continue

                    elev = marker.CreateElevation(
                        doc,
                        sourcePlan.Id,
                        idx
                    )

                    doc.Regenerate()

                    try:
                        elev.Name = elevName
                    except:
                        pass

                    try:
                        elev.Scale = int(viewScale)
                    except:
                        pass

                    try:
                        elev.CropBoxActive = True
                        elev.CropBoxVisible = False
                    except:
                        pass

                    try:

                        if idx in [0, 2]:
                            far_depth = room_depth * 1.2
                        else:
                            far_depth = room_width * 1.2

                        far_clip = elev.get_Parameter(
                            BuiltInParameter.VIEWER_BOUND_OFFSET_FAR
                        )

                        if far_clip and not far_clip.IsReadOnly:
                            far_clip.Set(far_depth)

                    except:
                        pass

                    try:
                        comments = elev.LookupParameter("Comments")
                        if comments:
                            comments.Set(
                                str(room.Id.IntegerValue)
                            )
                    except:
                        pass

                    created_views.append(elev)
                    
                    ###
                    set_project_browsing_view(elev)

                    total_elevations += 1

                    doc.Regenerate()

                success_count += 1

                results.append(
                    "SUCCESS : {} (Plan + Elevations)"
                    .format(room_title)
                )

            except Exception as ex:

                fail_count += 1

                try:
                    room_name = get_room_title(room)
                except:
                    room_name = "Unknown Room"

                results.append(
                    "FAILED : {} --> {}"
                    .format(
                        room_name,
                        str(ex)
                    )
                )

        TransactionManager.Instance.TransactionTaskDone()

        # =============================================
        # SUMMARY
        # =============================================

        activeLevelName = ""

        try:
            activeLevelName = sourcePlan.GenLevel.Name
        except:
            activeLevelName = "Unknown"

        summary = (
            "ROOM VIEW GENERATOR\n"
            "=====================================\n\n"
            "Active Level  : {}\n\n"
            "Rooms Selected: {}\n"
            "Successful    : {}\n"
            "Skipped       : {}\n"
            "Failed        : {}\n\n"
            "Plans Created : {}\n"
            "Elevations    : {}\n\n"
            "DETAILS\n"
            "-------------------------------------\n{}\n"
        ).format(
            activeLevelName,
            len(rooms),
            success_count,
            skipped_count,
            fail_count,
            plan_count,
            total_elevations,
            "\n".join(results)
        )

        try:

            MessageBox.Show(
                summary,
                "Room View Generator"
            )

        except:
            pass

        OUT = {
            "Views": created_views,
            "Rooms Selected": len(rooms),
            "Successful": success_count,
            "Skipped": skipped_count,
            "Failed": fail_count,
            "Plans Created": plan_count,
            "Elevations Created": total_elevations,
            "Details": results
        }
# ----------------------------------------
view_family_types_2 = ViewFamilyTypes("Floor Plan")  # graph input
collect_rooms_2 = Custom[© Collect.Rooms]()
titleblock_types = TitleblockTypes("TSΟ-AR-Title Block_A0:TSO_AR_A0")  # graph input
code_block = CodeBlock { Plan_Position_X:double=-0.400; Plan_Position_Y:double=0.300; Plan_Position_Z:double=0; }
byCoordinates = Point.ByCoordinates(x=code_block.Plan_Position_X, y=code_block.Plan_Position_Y, z=code_block.Plan_Position_Z)
code_block_2 = CodeBlock { North_Position_X:double=0.200; North_Position_Y:double=0.300; North_Position_Z:double=0; }
byCoordinates_2 = Point.ByCoordinates(x=code_block_2.North_Position_X, y=code_block_2.North_Position_Y, z=code_block_2.North_Position_Z)
code_block_3 = CodeBlock { East_Position_X:double=-0.400; East_Position_Y:double=-0.100; East_Position_Z:double=0; }
byCoordinates_3 = Point.ByCoordinates(x=code_block_3.East_Position_X, y=code_block_3.East_Position_Y, z=code_block_3.East_Position_Z)
code_block_4 = CodeBlock { South_Position_X:double=0.200; South_Position_Y:double=-0.100; South_Position_Z:double=0; }
byCoordinates_4 = Point.ByCoordinates(x=code_block_4.South_Position_X, y=code_block_4.South_Position_Y, z=code_block_4.South_Position_Z)
code_block_5 = CodeBlock { West_Position_X:double=-0.400; West_Position_Y:double=0.300; West_Position_Z:double=0; }
byCoordinates_5 = Point.ByCoordinates(x=code_block_5.West_Position_X, y=code_block_5.West_Position_Y, z=code_block_5.West_Position_Z)
code_block_6 = CodeBlock { SheetPrefix:string= "IE"; }
python_script_2 = Python(IN[0]=collect_rooms_2.valid, IN[1]=titleblock_types, IN[2]=byCoordinates, IN[3]=byCoordinates_2, IN[4]=byCoordinates_3, IN[5]=byCoordinates_4, IN[6]=byCoordinates_5, IN[7]=code_block_6)  # CPython3; graph output; frozen
# ---------- python_script_2.python (388 lines) ----------
import clr

clr.AddReference("RevitAPI")
clr.AddReference("RevitServices")
clr.AddReference("System.Windows.Forms")

from Autodesk.Revit.DB import *
from RevitServices.Persistence import DocumentManager
from RevitServices.Transactions import TransactionManager
from System.Windows.Forms import MessageBox

doc = DocumentManager.Instance.CurrentDBDocument

# ==================================================
# INPUTS
# ==================================================

rooms = UnwrapElement(IN[0]) if IN[0] else []

titleBlockType = UnwrapElement(IN[1]) if IN[1] else None

planPoint = IN[2]
northPoint = IN[3]
eastPoint = IN[4]
southPoint = IN[5]
westPoint = IN[6]

sheetPrefix = IN[7] if len(IN) > 7 and IN[7] else "IE"

# ==================================================
# HELPERS
# ==================================================

def get_room_number(room):

    try:
        p = room.LookupParameter("Number")
        if p and p.HasValue:
            return p.AsString()
    except:
        pass

    return str(room.Id.IntegerValue)


def get_room_name(room):

    try:
        p = room.LookupParameter("Name")
        if p and p.HasValue:
            return p.AsString()
    except:
        pass

    return "Unnamed"


def get_room_title(room):

    return "{} - {}".format(
        get_room_number(room),
        get_room_name(room)
    )


def point_to_xyz(pt):

    return XYZ(
        pt.X,
        pt.Y,
        0
    )


def sheet_exists(sheet_number):

    sheets = FilteredElementCollector(doc)\
        .OfClass(ViewSheet)

    for s in sheets:

        try:
            if s.SheetNumber.upper() == sheet_number.upper():
                return True
        except:
            pass

    return False


def find_room_views(room):

    roomTitle = get_room_title(room)

    plan = None
    north = None
    east = None
    south = None
    west = None

    allViews = FilteredElementCollector(doc)\
        .OfClass(View)

    for v in allViews:

        try:

            if v.IsTemplate:
                continue

            name = v.Name.upper()

            if name == (
                roomTitle + " - PLAN"
            ).upper():

                plan = v

            elif name == (
                roomTitle + " - NORTH"
            ).upper():

                north = v

            elif name == (
                roomTitle + " - EAST"
            ).upper():

                east = v

            elif name == (
                roomTitle + " - SOUTH"
            ).upper():

                south = v

            elif name == (
                roomTitle + " - WEST"
            ).upper():

                west = v

        except:
            pass

    return plan, north, east, south, west


def set_project_browsing_view(element):

    try:

        p = element.LookupParameter(
            "Project Browsing Sheet Packge"
        )

        if p and not p.IsReadOnly:
            p.Set("ROOMS")

    except:
        pass


# ==================================================
# VALIDATION
# ==================================================

if not rooms:

    OUT = "No rooms supplied."

elif not titleBlockType:

    OUT = "No title block supplied."

else:

    successCount = 0
    skipCount = 0
    failCount = 0

    createdSheets = []
    results = []

    TransactionManager.Instance.EnsureInTransaction(doc)

    for room in rooms:

        try:

            roomTitle = get_room_title(room)
            roomNumber = get_room_number(room)

            sheetNumber = "{}-{}".format(
                sheetPrefix,
                roomNumber
            )

            # =====================================
            # SHEET EXISTS?
            # =====================================

            if sheet_exists(sheetNumber):

                skipCount += 1

                results.append(
                    "SKIPPED : {} (Sheet exists)"
                    .format(sheetNumber)
                )

                continue

            # =====================================
            # FIND VIEWS
            # =====================================

            planView, northView, eastView, southView, westView = \
                find_room_views(room)

            missing = []

            if not planView:
                missing.append("PLAN")

            if not northView:
                missing.append("NORTH")

            if not eastView:
                missing.append("EAST")

            if not southView:
                missing.append("SOUTH")

            if not westView:
                missing.append("WEST")

            if missing:

                skipCount += 1

                results.append(
                    "SKIPPED : {} (Missing {})"
                    .format(
                        roomTitle,
                        ", ".join(missing)
                    )
                )

                continue

            # =====================================
            # CREATE SHEET
            # =====================================

            sheet = ViewSheet.Create(
                doc,
                titleBlockType.Id
            )

            sheet.SheetNumber = sheetNumber

            sheet.Name = (
                roomTitle +
                " Interior Elevations"
            )

            set_project_browsing_view(sheet)

            doc.Regenerate()

            # =====================================
            # PLAN
            # =====================================

            Viewport.Create(
                doc,
                sheet.Id,
                planView.Id,
                point_to_xyz(planPoint)
            )

            # =====================================
            # NORTH
            # =====================================

            Viewport.Create(
                doc,
                sheet.Id,
                northView.Id,
                point_to_xyz(northPoint)
            )

            # =====================================
            # EAST
            # =====================================

            Viewport.Create(
                doc,
                sheet.Id,
                eastView.Id,
                point_to_xyz(eastPoint)
            )

            # =====================================
            # SOUTH
            # =====================================

            Viewport.Create(
                doc,
                sheet.Id,
                southView.Id,
                point_to_xyz(southPoint)
            )

            # =====================================
            # WEST
            # =====================================

            Viewport.Create(
                doc,
                sheet.Id,
                westView.Id,
                point_to_xyz(westPoint)
            )

            doc.Regenerate()

            createdSheets.append(sheet)

            successCount += 1

            results.append(
                "SUCCESS : {}".format(sheetNumber)
            )

        except Exception as ex:

            failCount += 1

            results.append(
                "FAILED : {} --> {}"
                .format(
                    get_room_title(room),
                    str(ex)
                )
            )

    TransactionManager.Instance.TransactionTaskDone()

    # ==================================================
    # SUMMARY
    # ==================================================

    summary = (
        "ROOM SHEET GENERATOR\n"
        "=====================================\n\n"
        "Rooms Selected : {}\n"
        "Sheets Created : {}\n"
        "Skipped        : {}\n"
        "Failed         : {}\n\n"
        "DETAILS\n"
        "-------------------------------------\n{}\n"
    ).format(
        len(rooms),
        successCount,
        skipCount,
        failCount,
        "\n".join(results)
    )

    try:

        MessageBox.Show(
            summary,
            "Room Sheet Generator"
        )

    except:
        pass

    OUT = {
        "Sheets": createdSheets,
        "Created": successCount,
        "Skipped": skipCount,
        "Failed": failCount,
        "Details": results
    }
# ----------------------------------------
