# Dynamo graph GetAllViewsRoomsOnSheets.dyn (Dynamo 2.19.3.6394)
# packages: Rhythm 2025.10.3, Crumple 2026.8.1

collect_rooms = Custom[© Collect.Rooms]()  # package Crumple; Collects all valid/invalid rooms as two lists. Invalid rooms are not placed, or have issues that make their area invalid (not enclosed, redundant etc.).
titleblock_types = TitleblockTypes("TSΟ-AR-Title Block_A0:TSO_AR_A0")  # graph input
code_block_plan_view = CodeBlock { Plan_Position_X:double=2.7; Plan_Position_Y:double=1.8; Plan_Position_Z:double=0; }
byCoordinates = Point.ByCoordinates(x=code_block_plan_view.Plan_Position_X, y=code_block_plan_view.Plan_Position_Y, z=code_block_plan_view.Plan_Position_Z)
code_block_north_view = CodeBlock { North_Position_X:double=1.8; North_Position_Y:double=1.8; North_Position_Z:double=0; }
byCoordinates_2 = Point.ByCoordinates(x=code_block_north_view.North_Position_X, y=code_block_north_view.North_Position_Y, z=code_block_north_view.North_Position_Z)
code_block_east_view = CodeBlock { East_Position_X:double=0.3; East_Position_Y:double=1.8; East_Position_Z:double=0; }
byCoordinates_3 = Point.ByCoordinates(x=code_block_east_view.East_Position_X, y=code_block_east_view.East_Position_Y, z=code_block_east_view.East_Position_Z)
code_block_south_view = CodeBlock { South_Position_X:double=0.3; South_Position_Y:double=0.6; South_Position_Z:double=0; }
byCoordinates_4 = Point.ByCoordinates(x=code_block_south_view.South_Position_X, y=code_block_south_view.South_Position_Y, z=code_block_south_view.South_Position_Z)
code_block_west_view = CodeBlock { West_Position_X:double=1.8; West_Position_Y:double=0.6; West_Position_Z:double=0; }
byCoordinates_5 = Point.ByCoordinates(x=code_block_west_view.West_Position_X, y=code_block_west_view.West_Position_Y, z=code_block_west_view.West_Position_Z)
code_block = CodeBlock { SheetPrefix:string= "ROOM"; }
python_script_2 = Python(IN[0]=collect_rooms.valid, IN[1]=titleblock_types, IN[2]=byCoordinates, IN[3]=byCoordinates_2, IN[4]=byCoordinates_3, IN[5]=byCoordinates_4, IN[6]=byCoordinates_5, IN[7]=code_block)  # CPython3; graph output
# ---------- python_script_2.python (388 lines) ----------
import clr

clr.AddReference("RevitAPI")
clr.AddReference("RevitServices")
clr.AddReference("System.Windows.Forms")

from Autodesk.Revit.DB import *
from RevitServices.Persistence import DocumentManager
from RevitServices.Transactions import TransactionManager
from System.Windows.Forms import MessageBox

doc = DocumentManager.Instance.CurrentDBDocument

# ==================================================
# INPUTS
# ==================================================

rooms = UnwrapElement(IN[0]) if IN[0] else []

titleBlockType = UnwrapElement(IN[1]) if IN[1] else None

planPoint = IN[2]
northPoint = IN[3]
eastPoint = IN[4]
southPoint = IN[5]
westPoint = IN[6]

sheetPrefix = IN[7] if len(IN) > 7 and IN[7] else "IE"

# ==================================================
# HELPERS
# ==================================================

def get_room_number(room):

    try:
        p = room.LookupParameter("Number")
        if p and p.HasValue:
            return p.AsString()
    except:
        pass

    return str(room.Id.IntegerValue)


def get_room_name(room):

    try:
        p = room.LookupParameter("Name")
        if p and p.HasValue:
            return p.AsString()
    except:
        pass

    return "Unnamed"


def get_room_title(room):

    return "{} - {}".format(
        get_room_number(room),
        get_room_name(room)
    )


def point_to_xyz(pt):

    return XYZ(
        pt.X,
        pt.Y,
        0
    )


def sheet_exists(sheet_number):

    sheets = FilteredElementCollector(doc)\
        .OfClass(ViewSheet)

    for s in sheets:

        try:
            if s.SheetNumber.upper() == sheet_number.upper():
                return True
        except:
            pass

    return False


def find_room_views(room):

    roomTitle = get_room_title(room)

    plan = None
    north = None
    east = None
    south = None
    west = None

    allViews = FilteredElementCollector(doc)\
        .OfClass(View)

    for v in allViews:

        try:

            if v.IsTemplate:
                continue

            name = v.Name.upper()

            if name == (
                roomTitle + " - PLAN"
            ).upper():

                plan = v

            elif name == (
                roomTitle + " - NORTH"
            ).upper():

                north = v

            elif name == (
                roomTitle + " - EAST"
            ).upper():

                east = v

            elif name == (
                roomTitle + " - SOUTH"
            ).upper():

                south = v

            elif name == (
                roomTitle + " - WEST"
            ).upper():

                west = v

        except:
            pass

    return plan, north, east, south, west


def set_project_browsing_view(element):

    try:

        p = element.LookupParameter(
            "Project Browsing Sheet Packge"
        )

        if p and not p.IsReadOnly:
            p.Set("ROOMS")

    except:
        pass


# ==================================================
# VALIDATION
# ==================================================

if not rooms:

    OUT = "No rooms supplied."

elif not titleBlockType:

    OUT = "No title block supplied."

else:

    successCount = 0
    skipCount = 0
    failCount = 0

    createdSheets = []
    results = []

    TransactionManager.Instance.EnsureInTransaction(doc)

    for room in rooms:

        try:

            roomTitle = get_room_title(room)
            roomNumber = get_room_number(room)

            sheetNumber = "{}-{}".format(
                sheetPrefix,
                roomNumber
            )

            # =====================================
            # SHEET EXISTS?
            # =====================================

            if sheet_exists(sheetNumber):

                skipCount += 1

                results.append(
                    "SKIPPED : {} (Sheet exists)"
                    .format(sheetNumber)
                )

                continue

            # =====================================
            # FIND VIEWS
            # =====================================

            planView, northView, eastView, southView, westView = \
                find_room_views(room)

            missing = []

            if not planView:
                missing.append("PLAN")

            if not northView:
                missing.append("NORTH")

            if not eastView:
                missing.append("EAST")

            if not southView:
                missing.append("SOUTH")

            if not westView:
                missing.append("WEST")

            if missing:

                skipCount += 1

                results.append(
                    "SKIPPED : {} (Missing {})"
                    .format(
                        roomTitle,
                        ", ".join(missing)
                    )
                )

                continue

            # =====================================
            # CREATE SHEET
            # =====================================

            sheet = ViewSheet.Create(
                doc,
                titleBlockType.Id
            )

            sheet.SheetNumber = sheetNumber

            sheet.Name = (
                roomTitle +
                " Interior Elevations"
            )

            set_project_browsing_view(sheet)

            doc.Regenerate()

            # =====================================
            # PLAN
            # =====================================

            Viewport.Create(
                doc,
                sheet.Id,
                planView.Id,
                point_to_xyz(planPoint)
            )

            # =====================================
            # NORTH
            # =====================================

            Viewport.Create(
                doc,
                sheet.Id,
                northView.Id,
                point_to_xyz(northPoint)
            )

            # =====================================
            # EAST
            # =====================================

            Viewport.Create(
                doc,
                sheet.Id,
                eastView.Id,
                point_to_xyz(eastPoint)
            )

            # =====================================
            # SOUTH
            # =====================================

            Viewport.Create(
                doc,
                sheet.Id,
                southView.Id,
                point_to_xyz(southPoint)
            )

            # =====================================
            # WEST
            # =====================================

            Viewport.Create(
                doc,
                sheet.Id,
                westView.Id,
                point_to_xyz(westPoint)
            )

            doc.Regenerate()

            createdSheets.append(sheet)

            successCount += 1

            results.append(
                "SUCCESS : {}".format(sheetNumber)
            )

        except Exception as ex:

            failCount += 1

            results.append(
                "FAILED : {} --> {}"
                .format(
                    get_room_title(room),
                    str(ex)
                )
            )

    TransactionManager.Instance.TransactionTaskDone()

    # ==================================================
    # SUMMARY
    # ==================================================

    summary = (
        "ROOM SHEET GENERATOR\n"
        "=====================================\n\n"
        "Rooms Selected : {}\n"
        "Sheets Created : {}\n"
        "Skipped        : {}\n"
        "Failed         : {}\n\n"
        "DETAILS\n"
        "-------------------------------------\n{}\n"
    ).format(
        len(rooms),
        successCount,
        skipCount,
        failCount,
        "\n".join(results)
    )

    try:

        MessageBox.Show(
            summary,
            "Room Sheet Generator"
        )

    except:
        pass

    OUT = {
        "Sheets": createdSheets,
        "Created": successCount,
        "Skipped": skipCount,
        "Failed": failCount,
        "Details": results
    }
# ----------------------------------------
