# Dynamo graph GetLevels.dyn (Dynamo 2.19.3.6394)

file_path = Filename("..\..\4D\1.RSS\LEVELS_DYNAMO.xlsx")  # graph input
code_block = CodeBlock { "Levels"; 0; 0; true; false; }
categories = Categories("OST_Levels")
all_elements_of_category = ElementsOfCategory(Category=categories)
code_block_2 = CodeBlock { "Name"; "Elevation"; }
getParameterValueByName = Element.GetParameterValueByName(element=all_elements_of_category, parameterName=code_block_2.out0)
flatten = List.Flatten(list=getParameterValueByName)
exportToExcel = Data.ExportToExcel(filePath=file_path, sheetName=code_block.out0, startRow=code_block.out1, startColumn=code_block.out2, data=flatten, overWrite=code_block.out3, writeAsString=code_block.out4)  # graph output
code_block_3 = CodeBlock { "Levels"; 0; 1; false; false; }
getParameterValueByName_2 = Element.GetParameterValueByName(element=all_elements_of_category, parameterName=code_block_2.out1)
flatten_2 = List.Flatten(list=getParameterValueByName_2)
exportToExcel_2 = Data.ExportToExcel(filePath=file_path, sheetName=code_block_3.out0, startRow=code_block_3.out1, startColumn=code_block_3.out2, data=flatten_2, overWrite=code_block_3.out3, writeAsString=code_block_3.out4)  # graph output
