# Dynamo graph GetPointsFromGroup.dyn (Dynamo 2.19.3.6394)
# packages: GenerativeDesign.Revit 6.1.3.0

select_multiple_model_elements = DSModelElementMutlipleSelection()  # 2 picked in the model; graph input
python_script = Python(IN[0]=select_multiple_model_elements)  # CPython3
# ---------- python_script.python (79 lines) ----------
# Load the Python Standard and DesignScript Libraries
import sys
import clr
clr.AddReference('RevitAPI')
clr.AddReference('RevitServices')
clr.AddReference('RevitNodes')
clr.AddReference('ProtoGeometry')

from Autodesk.Revit.DB import *
from RevitServices.Persistence import DocumentManager
from Autodesk.DesignScript.Geometry import *

import Revit
clr.ImportExtensions(Revit.GeometryConversion)

# The inputs to this node will be stored as a list in the IN variables.
dataEnteringNode = IN

doc = DocumentManager.Instance.CurrentDBDocument


# Place your code below this line


elements = UnwrapElement(IN[0])

if not elements or len(elements) < 2:
    OUT = "Please provide at least 2 elements."
else:

    centers = []

    # Get center point of each element
    for el in elements:
        bbox = el.get_BoundingBox(None)

        if bbox:
            minPt = bbox.Min
            maxPt = bbox.Max

            center = XYZ(
                (minPt.X + maxPt.X) / 2.0,
                (minPt.Y + maxPt.Y) / 2.0,
                (minPt.Z + maxPt.Z) / 2.0
            )

            centers.append(center)

    if len(centers) >= 2:

        # First point
        firstPoint = centers[0]

        # Last point
        lastPoint = centers[-1]

        # Overall centroid of all points
        sumX = sum([pt.X for pt in centers])
        sumY = sum([pt.Y for pt in centers])
        sumZ = sum([pt.Z for pt in centers])

        count = len(centers)

        centroid = XYZ(
            sumX / count,
            sumY / count,
            sumZ / count
        )

        # Output:
        # [First Point, Last Point, Overall Centroid]
        OUT = [
            firstPoint.ToPoint(),
            lastPoint.ToPoint(),
            centroid.ToPoint()
        ]

    else:
        OUT = "Could not determine valid element centers."
# ----------------------------------------
deconstruct = List.Deconstruct(list=python_script)
code_block = CodeBlock(pt=deconstruct.first) { pt.X; pt.Y; pt.Z; }
byCoordinates = Point.ByCoordinates(x=code_block.out0, y=code_block.out1, z=code_block.out2)
lastItem = List.LastItem(list=python_script)
code_block_2 = CodeBlock(pt=lastItem) { pt.X; pt.Y; pt.Z; }
byCoordinates_2 = Point.ByCoordinates(y=code_block_2.out1, z=code_block_2.out2)
code_block_3 = CodeBlock { Width: int = 2000; Height: int = 2000; Depth: int = 2000; SectionName: string = "SectionXX"; }
python_script_2 = Python(IN[0]=byCoordinates, IN[1]=byCoordinates_2, IN[2]=code_block_3.Width, IN[3]=code_block_3.Height, IN[4]=code_block_3.Depth, IN[5]=code_block_3.SectionName)  # CPython3; graph output
# ---------- python_script_2.python (101 lines) ----------
# Load the Python Standard and DesignScript Libraries
import sys
import clr
clr.AddReference('ProtoGeometry')
clr.AddReference('RevitAPI')
clr.AddReference('RevitServices')
clr.AddReference('RevitNodes')

from Autodesk.Revit.DB import *
from Autodesk.DesignScript.Geometry import *
from RevitServices.Persistence import DocumentManager
from RevitServices.Transactions import TransactionManager

import Revit
clr.ImportExtensions(Revit.GeometryConversion)

# The inputs to this node will be stored as a list in the IN variables.
dataEnteringNode = IN
doc = DocumentManager.Instance.CurrentDBDocument


# Inputs
p1 = IN[0].ToXyz()
p2 = IN[1].ToXyz()
width = IN[2]
height = IN[3]
depth = IN[4]
sectionName = IN[5]

# Place your code below this line


# -------------------------
# FIXED VECTOR OPERATIONS
# -------------------------

# Midpoint (manual XYZ math)
mid = XYZ(
    (p1.X + p2.X) * 0.5,
    (p1.Y + p2.Y) * 0.5,
    (p1.Z + p2.Z) * 0.5
)

# Direction from p1 to p2
viewDir = XYZ(
    p2.X - p1.X,
    p2.Y - p1.Y,
    p2.Z - p1.Z
).Normalize()

# Up vector
up = XYZ.BasisZ

# Right vector
right = up.CrossProduct(viewDir).Normalize()

# Transform
transform = Transform.Identity
transform.Origin = mid
transform.BasisX = right      # Width
transform.BasisY = up         # Height
transform.BasisZ = viewDir    # Depth

# Bounding box
bbox = BoundingBoxXYZ()
bbox.Transform = transform

halfWidth = width / 2.0
halfHeight = height / 2.0

bbox.Min = XYZ(-halfWidth, -halfHeight, 0)
bbox.Max = XYZ(halfWidth, halfHeight, depth)

# Get section type
sectionType = None
collector = FilteredElementCollector(doc).OfClass(ViewFamilyType)

for vft in collector:
    if vft.ViewFamily == ViewFamily.Section:
        sectionType = vft
        break

if sectionType is None:
    OUT = "No section view type found."
else:
    TransactionManager.Instance.EnsureInTransaction(doc)

    section = ViewSection.CreateSection(
        doc,
        sectionType.Id,
        bbox
    )

    try:
        section.Name = sectionName
    except:
        pass

    TransactionManager.Instance.TransactionTaskDone()

    OUT = section
# ----------------------------------------
