# Dynamo graph ModelHealthDashboard.dyn (Dynamo 2.19.3.6394)

python_script = Python()  # CPython3; graph output; unwired: IN[0]
# ---------- python_script.python (65 lines) ----------
import os
from Autodesk.Revit.DB import *
from RevitServices.Persistence import DocumentManager
from RevitServices.Transactions import TransactionManager
from System.Windows.Forms import MessageBox, MessageBoxButtons, MessageBoxIcon

doc = DocumentManager.Instance.CurrentDBDocument

try:
    file_path = doc.PathName

    if file_path and file_path != "" and file_path != "<Internal>":
        file_size_mb = os.path.getsize(file_path) / (1024 * 1024)
        model_size = str(round(file_size_mb, 2)) + " MB"
    else:
        model_size = "Document not saved"

    element_count = FilteredElementCollector(doc).GetElementCount()#
    #element_count = len(
    #FilteredElementCollector(doc)
    #.WhereElementIsNotElementType()
    #.ToElements())
    model_elements = str(element_count) + " elements"
    
    warning_count = len(doc.GetWarnings())
    model_warnings = str(warning_count) + " warnings"
    
    link_count = FilteredElementCollector(doc).OfClass(RevitLinkInstance).GetElementCount()
    loaded_links = str(link_count) + " links"

    pi = FilteredElementCollector(doc).OfCategory(BuiltInCategory.OST_ProjectInformation).FirstElement()

    if pi is None:
        OUT = "Project Information element not found."
    else:
        TransactionManager.Instance.EnsureInTransaction(doc)

        results = []
        for pname, pvalue in [
            ("Model Size", model_size),
            ("Model Elements", model_elements),
            ("Model Warnings", model_warnings),
            ("Loaded Links", loaded_links)
        ]:
            p = pi.LookupParameter(pname)
            if p and not p.IsReadOnly:
                ok = p.Set(pvalue)
                results.append(pname + ": " + str(ok))
            else:
                results.append(pname + ": not found or read-only")

        TransactionManager.Instance.TransactionTaskDone()

        message = "MODEL STATISTICS\n\n" + \
                  "Model Size:     " + model_size + "\n" + \
                  "Model Elements: " + model_elements + "\n" + \
                  "Model Warnings: " + model_warnings + "\n" + \
                  "Loaded Links:   " + loaded_links + "\n\n" + \
                  "Write results:\n" + "\n".join(results)

        MessageBox.Show(message, "Model Statistics", MessageBoxButtons.OK, MessageBoxIcon.Information)
        OUT = [model_size, model_elements, model_warnings, loaded_links, results]

except Exception as e:
    OUT = "Error: " + str(e)
# ----------------------------------------
