# Dynamo graph ModelHealthDashboard_wip.dyn (Dynamo 2.19.3.6394)
# packages: Data-Shapes 2026.4.0

views = Views("_MODEL_STATISTICS_3D")
all_elements_in_view_s = Custom[All Elements In View(s)](Views=views)  # package Data-Shapes; Retrieves all visible element in a view or a set of views
python_script = Python(IN[0]=all_elements_in_view_s)  # CPython3; graph output
# ---------- python_script.python (226 lines) ----------
import os
from Autodesk.Revit.DB import *
from RevitServices.Persistence import DocumentManager
from RevitServices.Transactions import TransactionManager
from System.Windows.Forms import MessageBox, MessageBoxButtons, MessageBoxIcon


# ============================================================
# DOCUMENT
# ============================================================

doc = DocumentManager.Instance.CurrentDBDocument
uidoc = DocumentManager.Instance.CurrentUIApplication.ActiveUIDocument


try:

    # ========================================================
    # 1. MODEL SIZE
    # ========================================================

    file_path = doc.PathName

    if file_path and file_path != "" and file_path != "<Internal>":
        file_size_mb = os.path.getsize(file_path) / (1024 * 1024)
        model_size = str(round(file_size_mb, 2)) + " MB"
    else:
        model_size = "Document not saved"



    # ========================================================
    # 7. EXECUTE REVIT'S ACTUAL "SELECT ALL" COMMAND
    # ========================================================

    select_all_command_id = ( IN[0])
       

    if select_all_command_id is None:
        raise Exception(
            "Could not find Revit Select All command."
        )

    if not uidoc.CanPostCommand(select_all_command_id):
        raise Exception(
            "Revit Select All command cannot currently be executed."
        )

    uidoc.Application.PostCommand(
        select_all_command_id
    )


    # ========================================================
    # IMPORTANT
    #
    # PostCommand is asynchronous.
    #
    # The command is posted to Revit's UI queue and therefore
    # the selection is NOT necessarily available immediately
    # on the next line.
    # ========================================================


    # ========================================================
    # 8. READ THE RESULTING REVIT SELECTION
    # ========================================================

    selected_ids = uidoc.Selection.GetElementIds()

    element_count = selected_ids.Count

    model_elements = (
        str(element_count)
        + " elements"
    )


    # ========================================================
    # 9. MODEL WARNINGS
    # ========================================================

    warning_count = len(
        doc.GetWarnings()
    )

    model_warnings = (
        str(warning_count)
        + " warnings"
    )


    # ========================================================
    # 10. LOADED REVIT LINKS
    # ========================================================

    link_count = FilteredElementCollector(doc) \
        .OfClass(RevitLinkInstance) \
        .GetElementCount()

    loaded_links = (
        str(link_count)
        + " links"
    )


    # ========================================================
    # 11. PROJECT INFORMATION
    # ========================================================

    pi = FilteredElementCollector(doc) \
        .OfCategory(
            BuiltInCategory.OST_ProjectInformation
        ) \
        .FirstElement()


    if pi is None:

        OUT = "Project Information element not found."

    else:

        TransactionManager.Instance.EnsureInTransaction(doc)

        results = []

        parameters_to_write = [
            ("Model Size", model_size),
            ("Model Elements", model_elements),
            ("Model Warnings", model_warnings),
            ("Loaded Links", loaded_links)
        ]

        for pname, pvalue in parameters_to_write:

            p = pi.LookupParameter(pname)

            if p and not p.IsReadOnly:

                try:

                    ok = p.Set(pvalue)

                    results.append(
                        pname
                        + ": "
                        + str(ok)
                    )

                except Exception as parameter_error:

                    results.append(
                        pname
                        + ": ERROR - "
                        + str(parameter_error)
                    )

            else:

                results.append(
                    pname
                    + ": not found or read-only"
                )

        TransactionManager.Instance.TransactionTaskDone()


        # ====================================================
        # 12. MESSAGE
        # ====================================================

        message = (
            "MODEL STATISTICS\n\n"
            + "3D View:         "
            + three_d_view.Name
            + "\n"
            + "Model Size:      "
            + model_size
            + "\n"
            + "Model Elements:  "
            + model_elements
            + "\n"
            + "Model Warnings:  "
            + model_warnings
            + "\n"
            + "Loaded Links:    "
            + loaded_links
            + "\n\n"
            + "Selection:\n"
            + "Revit Select All command executed."
            + "\n"
            + "Selected elements: "
            + str(element_count)
            + "\n\n"
            + "Write results:\n"
            + "\n".join(results)
        )


        MessageBox.Show(
            message,
            "Model Statistics",
            MessageBoxButtons.OK,
            MessageBoxIcon.Information
        )


        # ====================================================
        # 13. DYNAMO OUTPUT
        # ====================================================

        OUT = [
            model_size,
            model_elements,
            model_warnings,
            loaded_links,
            results,
            three_d_view.Name,
            element_count
        ]


except Exception as e:

    OUT = "Error: " + str(e)
# ----------------------------------------
python_script_create__model = Python()  # "Python Script : Create _MODEL_STATISTICS_3D View"; IronPython2; graph output; unwired: IN[0]
# ---------- python_script_create__model.python (116 lines) ----------
import os
from Autodesk.Revit.DB import *
from RevitServices.Persistence import DocumentManager
from RevitServices.Transactions import TransactionManager
from System.Windows.Forms import MessageBox, MessageBoxButtons, MessageBoxIcon


# ============================================================
# DOCUMENT
# ============================================================

doc = DocumentManager.Instance.CurrentDBDocument
uidoc = DocumentManager.Instance.CurrentUIApplication.ActiveUIDocument


try:

   
    # ========================================================
    # 2. CREATE / USE DEDICATED 3D VIEW
    # ========================================================

    view_name = "_MODEL_STATISTICS_3D"

    three_d_view = None

    existing_views = FilteredElementCollector(doc) \
        .OfClass(View3D) \
        .ToElements()

    for v in existing_views:

        if not v.IsTemplate and v.Name == view_name:
            three_d_view = v
            break

    # ========================================================
    # 3. CREATE 3D VIEW IF REQUIRED
    # ========================================================

    if three_d_view is None:

        view_family_type = None

        view_family_types = FilteredElementCollector(doc) \
            .OfClass(ViewFamilyType) \
            .ToElements()

        for vft in view_family_types:

            if vft.ViewFamily == ViewFamily.ThreeDimensional:
                view_family_type = vft
                break

        if view_family_type is None:
            raise Exception(
                "Could not find a 3D ViewFamilyType."
            )

        TransactionManager.Instance.EnsureInTransaction(doc)

        three_d_view = View3D.CreateIsometric(
            doc,
            view_family_type.Id
        )

        three_d_view.Name = view_name

        TransactionManager.Instance.TransactionTaskDone()

    # ========================================================
    # 4. REMOVE ALL VIEW FILTERS
    # ========================================================

    TransactionManager.Instance.EnsureInTransaction(doc)

    filter_ids = three_d_view.GetFilters()

    for filter_id in filter_ids:

        try:
            three_d_view.RemoveFilter(filter_id)
        except:
            pass

    TransactionManager.Instance.TransactionTaskDone()

 
    # ====================================================
    # 13. DYNAMO OUTPUT
    # ====================================================

    OUT = [
          
            three_d_view.Name,
        ]


except Exception as e:

    OUT = "Error: " + str(e)
    
    
message = (
        "MODEL STATISTICS\n\n"
        + "3D View:         "
        + three_d_view.Name
    )


    MessageBox.Show(
        message,
        "Model Statistics",
        MessageBoxButtons.OK,
        MessageBoxIcon.Information
    )
# ----------------------------------------
