# Dynamo graph NullifyTypeIfcGUID.dyn (Dynamo 2.19.3.6394)

uniqueId = Element.UniqueId()  # frozen; unwired: element
python_script = Python(IN[0]=uniqueId)  # CPython3
# ---------- python_script.python (42 lines) ----------
# Load the Python Standard and DesignScript Libraries

# Boilerplate imports
import clr
clr.AddReference('RevitAPI')
from Autodesk.Revit.DB import *
import uuid



# The inputs to this node will be stored as a list in the IN variables.
# Inputs: 'IN[0]' = list of Elements
elements = IN[0]
# Place your code below this line

doc = __revit__.ActiveUIDocument.Document

t = Transaction(doc, 'Randomize UniqueId + Prep IFC GUID')
t.Start()

results = []
for el in elements:
    if el.Id.IntegerValue > 0:
        # Log old
        old_uid = el.UniqueId
        old_ifc = el.LookupParameter('IfcGUID')  # Clear cached if exists
        if old_ifc: old_ifc.Set('')

        # Regen UniqueId → triggers new IFC GUID on export
        el.RegenerateUniqueId()
        
        # Optional: Force fully random UniqueId (overkill)
        # new_uid = str(uuid.uuid4())
        # el.SetUniqueId(new_uid)  # API may not support direct set
        
        results.append({
            'old_uid': old_uid[:8],  # Trunc for display
            'new_uid': el.UniqueId[:8]
        })

t.Commit()
OUT = ['IFC GUIDs will be new on next export. Processed: {}'.format(len(results))]
# ----------------------------------------
select_model_elements = DSModelElementsSelection()  # 3309 picked in the model; graph input
elementType = Element.ElementType(element=select_model_elements)
string = StringInput("Type IfcGUID")
getParameterValueByName = Element.GetParameterValueByName(element=elementType, parameterName=string)
string_2 = StringInput("null")
setParameterByName = Element.SetParameterByName(element=elementType, parameterName=string, value=string_2)
