# Dynamo graph PassAssemblyToElement.dyn (Dynamo 2.19.3.6394)

categories = Categories("OST_Assemblies")  # graph input
all_elements_of_category = ElementsOfCategory(Category=categories)
JRT_4D_CODE = Input(JRT_4D_CODE: var[]..[])
python_script = Python(IN[0]=all_elements_of_category, IN[1]=JRT_4D_CODE)  # CPython3; graph output
# ---------- python_script.python (72 lines) ----------
import clr

# Revit API
clr.AddReference('RevitAPI')
from Autodesk.Revit.DB import *

# Revit Services
clr.AddReference('RevitServices')
from RevitServices.Persistence import DocumentManager
from RevitServices.Transactions import TransactionManager

# Current document
doc = DocumentManager.Instance.CurrentDBDocument

# Inputs
assemblies = UnwrapElement(IN[0])
paramName = IN[1]

updated = []
errors = []

# Start Transaction
TransactionManager.Instance.EnsureInTransaction(doc)

for assembly in assemblies:

    try:

        # Ensure object is AssemblyInstance
        if isinstance(assembly, AssemblyInstance):

            # Get source parameter from assembly
            sourceParam = assembly.LookupParameter(paramName)

            if sourceParam:

                # Read parameter value
                value = sourceParam.AsString()

                # Skip empty values
                if value:

                    # Get all member element IDs
                    memberIds = assembly.GetMemberIds()

                    for memberId in memberIds:

                        elem = doc.GetElement(memberId)

                        if elem:

                            # Find target parameter
                            targetParam = elem.LookupParameter(paramName)

                            # Ensure parameter exists and is writable
                            if targetParam and not targetParam.IsReadOnly:

                                # Handle parameter storage types
                                if targetParam.StorageType == StorageType.String:
                                    targetParam.Set(value)

                                updated.append(elem.Id.IntegerValue)

    except Exception as ex:

        errors.append(str(ex))

# End Transaction
TransactionManager.Instance.TransactionTaskDone()

# Output
OUT = (updated, errors)
# ----------------------------------------
