# Dynamo graph RemoveDuplicate Grids.dyn (Dynamo 2.19.3.6394)

string = StringInput("Name")
categories = Categories("OST_Grids")
all_elements_of_category = ElementsOfCategory(Category=categories)
name = Element.Name(element=all_elements_of_category)
python_script = Python(IN[0]=name, IN[1]=all_elements_of_category)  # CPython3; graph output
# ---------- python_script.python (18 lines) ----------
# IN[0] = flat list of name STRINGS (use Flatten node if nested)
# IN[1] = list of grid ELEMENTS (same length/order)

names = IN[0]  # Ensure flat: strings only!
grids = IN[1]

from collections import OrderedDict  # Preserves first occurrence order

seen = OrderedDict()
duplicates = []

for i, name in enumerate(names):
    if name in seen:
        duplicates.append(grids[i])
    else:
        seen[name] = True  # str is hashable!

OUT = duplicates  # Grids to delete (connect to Element.Delete)
# ----------------------------------------
delete = Element.Delete(element=python_script)
